# Dynamo graph Circles.dyn "circles" (Dynamo 2.7.0.15211)

number = DoubleInput(0)
code_block = CodeBlock { 10; 10; }
number_slider = DoubleSlider(15.6, range=0..100 step 0.1)
sequence = Sequence(start=code_block.out0, amount=number_slider, step=code_block.out1)
byCoordiate = SldWorksNodes.Geometry.Point3D.ByCoordiate(x=number, y=number, z=sequence)
byCenterRadius = SldWorksNodes.Geometry.Circle3D.ByCenterRadius(center=byCoordiate, radius=sequence)
