# Dynamo graph CodeNumSplit.dyn "图号分离" (Dynamo 2.13.1.3887)

# group: 获取名称
current = SldWorksNodes.Document.Document.Current()
string_from_object = FromObject(object=current)
length = String.Length(string=string_from_object)

code_block = CodeBlock { 7; 0; " "; 0; 1; }

# group: 分离字符
sub = length - code_block.out0
substring = String.Substring(string=string_from_object, startIndex=code_block.out1, length=sub)
split = String.Split(string=substring, separator0=code_block.out2)

# group: 创建属性
code_block_2 = CodeBlock { "代号"; "名称"; }
getItemAtIndex = List.GetItemAtIndex(list=split, index=code_block.out3)
byNameText = SldWorksNodes.CustomProperty.CustomProperty.ByNameText(name=code_block_2.out0, value=getItemAtIndex)
getItemAtIndex_2 = List.GetItemAtIndex(list=split, index=code_block.out4)
byNameText_2 = SldWorksNodes.CustomProperty.CustomProperty.ByNameText(name=code_block_2.out1, value=getItemAtIndex_2)
