# Dynamo graph Cylinder.dyn (Dynamo 2.7.0.15211)

code_block = CodeBlock { 10; 120; 10; "实体"; }

# group: Compute
range = Range(start=code_block.out0, end=code_block.out1, step=code_block.out2)
zero = DoubleInput(0)
byCoordiate = SldWorksNodes.Geometry.Point3D.ByCoordiate(x=range, y=zero, z=zero)
data = CodeBlock { 1; 3; }
byDirection = SldWorksNodes.Geometry.Vector3D.ByDirection(x=zero, y=zero, z=data.out0)
abs = Math.Abs(number=range)

byClinder = SldWorksNodes.Geometry.Body.ByClinder(center=byCoordiate, axis=byDirection, radius=data.out1, height=abs)
