# Dynamo graph Equation.dyn (Dynamo 2.7.0.15211)

code_block = CodeBlock { 0; }
byIndex = SldWorksNodes.EquationMgr.Equation.ByIndex(index=code_block)
code_block_2 = CodeBlock { "\"a\"=30"; }
setValue = SldWorksNodes.EquationMgr.Equation.SetValue(equation=byIndex, equation_2=code_block_2)
