# Dynamo graph FaceAreaToCustomProperty.dyn (Dynamo 2.7.0.15211)

property_name = CodeBlock { "面积"; }

# group: Get Face Area
face_id = CodeBlock()
# ---------- face_id.designscript (1 lines) ----------
"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";
# ----------------------------------------
byPID = SldWorksNodes.Brep.Face.ByPID(pid=face_id)
code_block = CodeBlock(face1=byPID) { num1 = Face.Area(face1); }

# group: Add Property
byNameDouble = SldWorksNodes.CustomProperty.CustomPropertyCreation.ByNameDouble(name=property_name, value=code_block)
add = SldWorksNodes.CustomProperty.CustomPropertyManager.Add(customProperty=byNameDouble)
