# Dynamo graph Geometry.dyn "geo" (Dynamo 2.7.0.15211)

# group: Cylinder
code_block = CodeBlock { Point3D.ByCoordinate(20,20,0); Vector3D.ByCoordinate(0,0,1); 10; }
byCenterAxisRaduisHeight = SldWorksNodes.Geometry.Cylinder.ByCenterAxisRaduisHeight(center=code_block.out0, axis=code_block.out1, radius=code_block.out2, height=code_block.out2)

# group: Cone
code_block_2 = CodeBlock { Point3D.ByCoordinate(0,0,0); 10; }
byCenter2RaduisHeight = SldWorksNodes.Geometry.Cone.ByCenter2RaduisHeight(center=code_block_2.out0, height=code_block_2.out1, bottomRaduis=code_block_2.out1)

# group: Box
code_block_3 = CodeBlock { Point3D.ByCoordinate(30,30,0); Point3D.ByCoordinate(40,40,10); }
byBox = SldWorksNodes.Geometry.Cube.ByBox(LeftDown=code_block_3.out0, TopRight=code_block_3.out1)

# group: Line
code_block_4 = CodeBlock { Point3D.ByCoordinate(0,0,0); Point3D.ByCoordinate(100,100,0); }
byStartAndEnd = SldWorksNodes.Geometry.Line3D.ByStartAndEnd(startPoint=code_block_4.out0, endPoint=code_block_4.out1)

# group: Circle
code_block_5 = CodeBlock { Point3D.ByCoordinate(0,0,0); 100; }
byCenterRadius = SldWorksNodes.Geometry.Circle3D.ByCenterRadius(center=code_block_5.out0, radius=code_block_5.out1)
