# Dynamo graph ReNameDocByProperties.dyn (Dynamo 2.7.0.15211)

# group: Input
code_block = CodeBlock { "名称"; "-"; "材料"; }
string = StringInput("Block")
string_2 = StringInput("Ht200")

# group: CombineProperties
current = SldWorksNodes.Document.Document.Current()
byNameText = SldWorksNodes.CustomProperty.CustomPropertyCreation.ByNameText(name=code_block.out0, value=string)
value = SldWorksNodes.CustomProperty.CustomProperty.Value(customProperty=byNameText)
byNameText_2 = SldWorksNodes.CustomProperty.CustomPropertyCreation.ByNameText(name=code_block.out2, value=string_2)
value_2 = SldWorksNodes.CustomProperty.CustomProperty.Value(customProperty=byNameText_2)
concat = String.Concat(string0=value, string1=code_block.out1, string2=value_2)

# group: ReName
reName = SldWorksNodes.Document.Document.ReName(document=current, newName=concat)
