# Dynamo graph SkeCircle.dyn (Dynamo 1.2.2.373)

orign = SldWorksNodes.Geometry.Point3D.Orign()
code_block = CodeBlock { 10..100..#10; 0; }
byCoordinates = SldWorksNodes.Geometry.Point3D.ByCoordinates(code_block.out0, code_block.out1, code_block.out1)
byCoordinates_2 = SldWorksNodes.Geometry.Point3D.ByCoordinates(code_block.out1, code_block.out0, code_block.out1)
byThreePoints = SldWorksNodes.Sketch.SketchArc.ByThreePoints(orign, byCoordinates, byCoordinates_2)
