# Dynamo graph Sketch.dyn (Dynamo 1.2.2.373)

code_block = CodeBlock { 0..100..#10; 0; }
byCoordinates = SldWorksNodes.Geometry.Point3D.ByCoordinates(code_block.out0, code_block.out1, code_block.out1)
reverse = List.Reverse(code_block.out0)
byCoordinates_2 = SldWorksNodes.Geometry.Point3D.ByCoordinates(code_block.out1, reverse, code_block.out1)
byStartPointAndEndPoint = SldWorksNodes.Sketch.SketchLine.ByStartPointAndEndPoint(byCoordinates, byCoordinates_2)
code_block_2 = CodeBlock { 100; 0; }
byCoordinates_3 = SldWorksNodes.Geometry.Point3D.ByCoordinates(code_block.out0, code_block_2.out0, code_block_2.out1)
byCoordinates_4 = SldWorksNodes.Geometry.Point3D.ByCoordinates(code_block_2.out0, reverse, code_block_2.out1)
byStartPointAndEndPoint_2 = SldWorksNodes.Sketch.SketchLine.ByStartPointAndEndPoint(byCoordinates_3, byCoordinates_4)
