# Dynamo graph SketchLine.dyn (Dynamo 1.2.2.373)

select_feature = SelectFeature()  # 1 picked in the model
byFeature = SldWorksNodes.Sketch.Sketch.ByFeature(select_feature)
bySketch = SldWorksNodes.Sketch.SketchLine.BySketch(byFeature)
code_block = CodeBlock { 0; 10; }
byCoordinates = SldWorksNodes.Geometry.Point3D.ByCoordinates(code_block.out0, code_block.out0, code_block.out0)
number_slider = DoubleSlider(370, range=0..1000 step 10)
byCoordinates_2 = SldWorksNodes.Geometry.Point3D.ByCoordinates(number_slider, number_slider, code_block.out1)
startPointAndEndPoint = SldWorksNodes.Sketch.SketchLine.StartPointAndEndPoint(bySketch, byCoordinates, byCoordinates_2)
