# Dynamo graph surface.dyn (Dynamo 2.13.1.3887)

orign = SldWorksNodes.Geometry.Point3D.Orign()
ZAxis = SldWorksNodes.Geometry.Vector3D.ZAxis()
code_block = CodeBlock { 20; }
number_slider = DoubleSlider(80.2, range=0..100 step 0.1)
byCenterPointDirectionsAndRaduis = SldWorksNodes.Geometry.CylindricalSurface.ByCenterPointDirectionsAndRaduis(center=orign, direction=ZAxis, radius=code_block, height=number_slider)
