# Dynamo graph 图号分离.dyn (Dynamo 1.2.2.373)

# group: 获取名称
current = SldWorksNodes.Document.Document.Current()
string_from_object = FromObject(current)
length = String.Length(string_from_object)

code_block = CodeBlock { 7; 0; " "; 0; 1; }

# group: 分离字符
sub = length - code_block.out0
substring = String.Substring(str=string_from_object, startIndex=code_block.out1, length=sub)
split = String.Split(substring, code_block.out2)

# group: 创建属性
code_block_2 = CodeBlock { "代号"; "名称"; }
getItemAtIndex = List.GetItemAtIndex(list=split, index=code_block.out3)
byNameText = SldWorksNodes.CustomProperty.CustomProperty.ByNameText(code_block_2.out0, getItemAtIndex)
getItemAtIndex_2 = List.GetItemAtIndex(list=split, index=code_block.out4)
byNameText_2 = SldWorksNodes.CustomProperty.CustomProperty.ByNameText(code_block_2.out1, getItemAtIndex_2)
