# Dynamo graph 随机着色.dyn (Dynamo 2.13.1.3887)

# group: 获取所有零件
current = SldWorksNodes.Document.Document.Current()
asAssemblyDocument = SldWorksNodes.Document.Document.AsAssemblyDocument(document=current)
顶级_全部 = BoolSelector(true)  # graph input
components = SldWorksNodes.Document.AssemblyDocument.Components(assemblyDocument=asAssemblyDocument, toplevelOnly=顶级_全部)

# group: 生成随机颜色
count = List.Count(list=components)
randomList = Math.RandomList(amount=count)
code_block = CodeBlock { 0; 255; }
mul = randomList * code_block.out1
randomList_2 = Math.RandomList(amount=count)
mul_2 = randomList_2 * code_block.out1
randomList_3 = Math.RandomList(amount=count)
mul_3 = randomList_3 * code_block.out1

# group: 设置颜色
materialProperty = SldWorksNodes.MaterialProperty.MaterialProperty(r=mul, g=mul_2, b=mul_3)
setMaterialProperty = SldWorksNodes.Assembly.Component.SetMaterialProperty(component=components, materialProperty=materialProperty)
